# Grasshopper definition Example1_Large_Perforations.gh (Grasshopper 1.0.8)
# plug-ins: Pterodactyl, Abalone

# ---- group: Option: plot probability of acceptance with Pterodactyl / User Controls
efficiency_fraction = Slider(0.85, range=0..1)

# ---- group: Initial Hole Parameters
# -- Hole Initialisation --
# 
# All values will change, except for the hole aspect ratio, which remains constant throughout optimisation.
# 
# In this example, we consider 1 initial hole, at the plate centre.
# 
# Thus X- and Y- Spacing is 0
number_slider = Slider(75, range=1..100)
number_slider_2 = Slider(1, range=0..5)
number_slider_3 = Slider(0, range=0..10)
number_slider_4 = Slider(0, range=0..10)
number_slider_5 = Slider(1, range=1..10)
number_slider_6 = Slider(1, range=1..100)
multiplication = Multiplication(A=number_slider_2, B=number_slider)

# ---- group: Material Constants
number_slider_7 = Slider(203400, range=0..1000000)
number_slider_8 = Slider(0.3, range=0..1)

# ---- group: Plate Geometry
# -- Thin Plate --
# 
# Ensure that the 'slenderness' is no less than 75
# 
# i.e. b/t > 75
# 
# Otherwise, the semi-empirical approximations for elastic buckling capacity within the Optimise component will not be valid
number_slider_9 = Slider(1000, range=0..1000)
number_slider_10 = Slider(150, range=0..1000)
number_slider_11 = Slider(2, range=1..10)

# ---- group: Constraints -- Large Holes
# -- Large Holes --
# 
# A 'large' hole has a height >0.6Y
# 
# So let the minimum be no less than 0.5Y in this example.
# 
# Note that this makes the 'min hole area' constraint of 1000mm^2 redundant (i.e. the constraint is controlled by min hole height in this example).
# 
# The initial hole height should be initialised to comply with this constraint, i.e. h_i = 75
# 
# The constraints on Y-spacing are redundant, this setup will not allow multiple rows (the minimum hole height is too great).
# 
# The X-Margin is set to equal b. Try changing this constraint to see its affect on the result.
# In general, the X-margin should be > b.
number_slider_12 = Slider(1000, range=0..1000)
number_slider_13 = Slider(20, range=1..100)
number_slider_14 = Slider(10, range=0..1000)
number_slider_15 = Slider(10, range=1..10)
multiplication_2 = Multiplication(A=number_slider_10, B="0.5")
multiplication_3 = Multiplication(A=number_slider_10, B="1")

# ----
cooling_function = ValueList({"Linear": 0, "Exponential": 1, "Logarithmic": 2, "Reciprocal": 3, "Quadratic": 4}, selected="Exponential")
efficiency_mode = ValueList({"Default": 0, "EfficiencyA": 0, "EfficiencyB": 0}, selected="Default")
initialgeometry = InitialGeometry(
    PlateLengthX=number_slider_9,
    PlateWidthY=number_slider_10,
    Thickness=number_slider_11,
    YoungsModulus=number_slider_7,
    PoissonsRatio=number_slider_8,
    HoleAspectRatio=number_slider_2,
    HoleLength=multiplication,
    HoleHeight=number_slider,
    XSpacing=number_slider_3,
    YSpacing=number_slider_4,
    Columns=number_slider_5,
    Rows=number_slider_6)
constraints = ConstructConstraints(
    MinHoleArea=number_slider_12,
    MinHoleHeight=multiplication_2,
    MinXSpacing=number_slider_13,
    MaxXSpacing=number_slider_9,
    XMargin=multiplication_3,
    MinYSpacing=number_slider_14,
    MaxYSpacing=number_slider_10,
    YMargin=number_slider_15)
panel = Panel(initialgeometry)
panel_2 = Panel(constraints)

# ---- group: Option: plot probability of acceptance with Pterodactyl / Print graph with Pterodactyl
# -- Pterodactyl --
# 
# Option to use the Pterodactyl plugin to visualise how the probability of acceptance changes with respect to step.
# 
# From Food4Rhino: https://www.food4rhino.com/en/app/pterodactyl
# 
# 
# Collect the efficiency from each step and use this to determine a hypothetical efficiency at the next step. Change the efficiency fraction as desired, e.g. here the hypothetical efficiency is 85% of the previous step.
# 
# Change the user controls to plot the graph (the directory and folder where you wish to save an image of the resulting graph).
# 
# Click show graph below.
# 
# Try (1) changing alpha (2) changing T and (3) changing the cooling function to see how this affects the probability of acceptance.
show_graph = Button()

# ---- group: Option: plot probability of acceptance with Pterodactyl / User Controls
panel_3 = Panel("C:\path")
panel_4 = Panel("Graphs")

# ---- group: Option: plot probability of acceptance with Pterodactyl
panel_5 = Panel("5")
series = Series(Start=Slider(1, range=0..20), Step=Slider(1, range=0..20), Count=panel_5)

# ---- group: Optimise
# -- Optimise --
# 
# Try changing the random seed, max # iterations, cooling function, and cooling function parameters.
# 
# Nothing will change.
# 
# This means that the result is likely to be the most optimal arrangement of perforations, given the constraints.
# 
# Notice that the solution completed before exhausting the max # iterations.
# 
# Next: Try changing (1) The hole aspect ratio (2) The X-margin.
number_slider_16 = Slider(169, range=1..1000)
number_slider_17 = Slider(11, range=1..50)
panel_6 = Panel("""S
C
G
R""")
number_slider_18 = Slider(1, range=0..1)
number_slider_19 = Slider(0.497, range=0..1)

# ----
optimise = Optimise(
    RandomSeed=number_slider_16,
    MaxIterations=number_slider_17,
    Rules=panel_6,
    Geometry=initialgeometry,
    Constraints=constraints,
    CoolingFunctionCF=cooling_function,
    InitialT=number_slider_18,
    Alpha=number_slider_19,
    EfficiencyMode=efficiency_mode,
    K=Slider(3, range=1..5))

# ---- group: Option: plot probability of acceptance with Pterodactyl (continued)
deconstruct = DeconstructGeometry(Geometry=optimise, Iteration=series)  # -> HoleLength, HoleHeight, Columns, Rows, XSpacing, YSpacing, HoleCentres, Efficiency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
panel_7 = Panel(deconstruct.Efficiency)
probability_of_acceptence = ProbabilityOfAcceptence(
    data=panel_7,
    cooling_schedule=cooling_function,
    T=number_slider_18,
    alpha=number_slider_19,
    step_max=panel_5,
    num=efficiency_fraction)  # -> out, num_3
panel_8 = Panel(probability_of_acceptence.out)

py3 = Python3Script()  # -> flatten(colour)
# ---------- py3: Python ----------
if cooling_schedule == 1:
    colour = "97,203,244"
elif cooling_schedule == 2:
    colour = "160,43,147"
elif cooling_schedule == 3:
    colour = "71,212,90"
elif cooling_schedule == 4:
    colour = "233,113,50"
elif cooling_schedule == 0:
    colour = "0,0,255"
print(colour)
# ---------- end py3 ----------
create_x_y_data = CreateXYData(cooling_schedule=cooling_function, T=number_slider_18, alpha=number_slider_19, step_max=panel_5, _0_1=panel_8)  # -> R, R_2
line_data = LineData(Color=ColourSwatch(SwatchColor=RGB(0, 0, 0)), Interpolation=0, LineStyle=0, LineWeight=2)
line_data_2 = LineData(Color=py3, Interpolation=0, LineStyle=0, LineWeight=2)
py3_2 = Python3Script(p=probability_of_acceptence.num_3)  # -> Labels
# ---------- py3_2: Python ----------
ys = ["Temperature"]
ys.append(f"Probability of accepting e_o = {p*100}% of e_i")

ys = "\n".join(str(i) for i in ys)
print(ys)
# ---------- end py3_2 ----------
graph_data = GraphData(XValues=create_x_y_data.R, YValues=create_x_y_data.R_2, ValuesNames=py3_2, DataTypes=[line_data_2, line_data])

# ---- group: Deconstruct
# -- Deconstruct --
# 
# Determine values associated with each step in the optimisation procedure.
# 
# In the 1st iteration, the column (C) rule was selected, giving an efficiency as shown.
# 
# The result is two perforations, located with their centres at the co-ordinates listed (x, y, z).
# 
# The hole length and hole height are equal to what they were when they began, as the geometry has not been grown (G) or shrunk (S).
# 
# Similarly, there is only 1 row of perforations, as the row (R) rule has not been selected, and we initialised 1 row in the beginning.
number_slider_20 = Slider(1, range=0..10)
deconstruct_2 = DeconstructGeometry(Geometry=optimise, Iteration=number_slider_20)  # -> HoleLength, HoleHeight, Rows, Columns, XSpacing, YSpacing, HoleCentres, Efficiency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
panel_9 = Panel(deconstruct_2.Efficiency)
panel_10 = Panel(deconstruct_2.Capacity)
panel_11 = Panel(deconstruct_2.RuleSelected)
panel_12 = Panel(deconstruct_2.HoleLength)
panel_13 = Panel(deconstruct_2.HoleHeight)
panel_14 = Panel(deconstruct_2.YSpacing)
panel_15 = Panel(deconstruct_2.Columns)
panel_16 = Panel(deconstruct_2.XSpacing)
panel_17 = Panel(deconstruct_2.Rows)
panel_18 = Panel(deconstruct_2.HoleCentres)

# ---- group: Optimise (continued)
panel_19 = Panel(optimise)

# ---- group: Option: plot probability of acceptance with Pterodactyl
# Note that the error will vanish when the plot graph button is pressed.
panel_20 = Panel("Temperature-Probability")
graph_legend = GraphLegend(Title="Legend", Position="2", Placement=0, Orientation=1, TextSize="20")
file_pather = Python3Script(Title=panel_20, Probability=efficiency_fraction, T=number_slider_18, alpha=number_slider_19)  # -> out
# ---------- file_pather: Python ----------
if cooling_schedule == 0:
    label = "Linear-Cooling"
elif cooling_schedule == 1:
    label = "Exponential-Cooling"
elif cooling_schedule == 2:
    label = "Logarithmic-Cooling"
elif cooling_schedule == 3:
    label = "Reciprocal-Cooling"
elif cooling_schedule == 4:
    label = "Quadratic-Cooling"


alpha = str(alpha).replace(".", "_")
T = str(T).replace(".", "_")
p = int(float(Probability)*100)
print(Title + "-" + label + "-p" + str(p)+ "-T"+T + "-alpha"+alpha)
# ---------- end file_pather ----------
graph_sizes = GraphSizes(Width="1000", Height="1000")
graph_axis = GraphAxis(XAxisName="Step", YAxisName="Temperature/Probability of Acceptance", AxisPadding=0.01, TextSize="20")
graph_elements = GraphElements(GraphData=graph_data, GraphLegend=graph_legend)
graph_settings = GraphSettings(
    Title="Cooling Schedule With Step",
    GraphSizes=graph_sizes,
    Background=RGB(255, 255, 255),
    GraphAxis=graph_axis,
    GraphPadding="50",
    TitleSize="20")
file_pather_2 = Python3Script(Main_Directory=panel_3, Folder=panel_4, File_Name=file_pather)  # -> out
# ---------- file_pather_2: Python ----------
from datetime import date
today = date.today()
day = today.day
month = today.month
year = today.year

date_stamp = str(day)+"_"+str(month)

out = Main_Directory + "\\" + Folder + "\\" + date_stamp + "_" + File_Name + ".png"
print(out)
# ---------- end file_pather_2 ----------
py3_3 = Python3Script(x=show_graph, path=file_pather_2)  # -> path
# ---------- py3_3: Python ----------
if x is True:
    print(path)
# ---------- end py3_3 ----------
graph = Graph(ShowGraph=show_graph, GraphElements=graph_elements, GraphSettings=graph_settings, Path=py3_3)

# ---- group: Visualise
# -- Undo & Mesh --
# 
# Visualise how the geometry progresses by changing the 'step'.
# 
# Set Step = 0 to get the final geometry
# 
# Set Step = 2 to go two back from the final.
# 
# Set Step = History count (see output from optimised geometry) to see the first iteration.
number_slider_21 = Slider(4, range=0..10)
undogeometry = UndoGeometry(Geometry=optimise, Step=number_slider_21)
materializegeometry = MaterializeGeometry(Geometry=undogeometry, MeshUCount=Slider(75, range=1..100), MeshVCount=Slider(51, range=1..100))  # -> Brep, Mesh
brep = Brep(materializegeometry.Brep)

# ==== cluster ProbabilityOfAcceptence
data = ClusterInput()
num = ClusterInput()
data_2 = Data(data)
num_2 = Number(num)
num_3 = ClusterOutput(num_2)
cooling_schedule = ClusterInput()
T = ClusterInput()
alpha = ClusterInput()
step_max = ClusterInput()
py3 = Python3Script(x=data_2, y=num_2)  # -> z; inputs x: list
# ---------- py3: Python ----------
z = []
for i in x:
    z.append(y*float(i))

z = "\n".join(str(i) for i in z)
print(z)
# ---------- end py3 ----------
py3_2 = Python3Script(e1=data_2, e2=py3, cooling_schedule=cooling_schedule, T=T, alpha=alpha, step_max=step_max)  # -> flatten(out); inputs e1: list, e2: list
# ---------- py3_2: Python ----------
import math

xs = list(range(0,int(step_max)))
ys = []

for (ei, eo, x) in zip(e1, e2, xs):
    if cooling_schedule == 0:
        label = "Linear Cooling"
        nt = max(T- alpha*(x), 0.000001)
    elif cooling_schedule == 1:
        label = "Exponential Cooling"
        nt = T*alpha**x
    elif cooling_schedule == 2:
        label = "Logarithmic Cooling"
        nt = T/math.log(x + alpha)
    elif cooling_schedule == 3:
        label = "Reciprocal Cooling"
        nt = T/(1 + alpha*x)
    elif cooling_schedule == 4:
        label = "Quadratic Cooling"
        nt = T/(1 + alpha*x**2)
    
    ys.append(math.exp(-(float(ei) - float(eo))/float(nt)))

ys = "\n".join(str(i) for i in ys)

print(ys)
# ---------- end py3_2 ----------
out = ClusterOutput(py3_2)

# ==== cluster CreateXYData
cooling_schedule = ClusterInput()
T = ClusterInput()
alpha = ClusterInput()
step_max = ClusterInput()
py3 = Python3Script(cooling_schedule=cooling_schedule, T=T, alpha=alpha, step_max=step_max)  # -> out
# ---------- py3: Python ----------
import math

print(cooling_schedule)

xs = list(range(int(step_max)))
ys = []

for x in xs:
    if cooling_schedule == 0:
        label = "Linear Cooling"
        ys.append(max(T- alpha*(x), 0.000001))
    elif cooling_schedule == 1:
        label = "Exponential Cooling"
        ys.append(T*alpha**x)
    elif cooling_schedule == 2:
        label = "Logarithmic Cooling"
        ys.append(T/math.log(x + alpha))
    elif cooling_schedule == 3:
        label = "Reciprocal Cooling"
        ys.append(T/(1 + alpha*x))
    elif cooling_schedule == 4:
        label = "Quadratic Cooling"
        ys.append(T/(1 + alpha*x**2))

ys = "\n".join(str(i) for i in ys)
print(ys)
print(label)
# ---------- end py3 ----------
series = Series(Start=Slider(1, range=0..20), Step=Slider(1, range=0..20), Count=step_max)
split = SplitList(List=py3, Index=step_max)  # -> ListA, ListB
_0_1 = ClusterInput()
entwine = Entwine(Branch00=series, Branch01=series, FlattenInputs=True)
entwine_2 = Entwine(Branch00=split.ListA, Branch01=_0_1, FlattenInputs=True)
R = ClusterOutput(entwine)
R_2 = ClusterOutput(entwine_2)
