# Grasshopper definition Example2_Multiple_Rows.gh (Grasshopper 1.0.8)
# plug-ins: Pterodactyl, Abalone

# ---- group: Option: plot probability of acceptance with Pterodactyl / User Controls
efficiency_fraction = Slider(0.85, range=0..1)

# ---- group: Initial Hole Parameters
# -- Hole Initialisation --
# 
# All values will change, except for the hole aspect ratio, which remains constant throughout optimisation.
# 
# In this example, we consider 2 initial holes, arranged into two rows.
# 
# Ensure that the initial Y-spacing complies with the minimum permitted.
number_slider = Slider(35, range=1..100)
number_slider_2 = Slider(1.5, range=0..5)
number_slider_3 = Slider(0, range=0..10)
number_slider_4 = Slider(15, range=0..25)
number_slider_5 = Slider(1, range=1..10)
number_slider_6 = Slider(2, range=1..100)
multiplication = Multiplication(A=number_slider_2, B=number_slider)

# ---- group: Material Constants
number_slider_7 = Slider(203400, range=0..1000000)
number_slider_8 = Slider(0.3, range=0..1)

# ---- group: Plate Geometry
# -- Thin Plate --
# 
# Ensure that the 'slenderness' is no less than 75
# 
# i.e. b/t > 75
# 
# Otherwise, the semi-empirical approximations for elastic buckling capacity within the Optimise component will not be valid
number_slider_9 = Slider(1000, range=0..1000)
number_slider_10 = Slider(150, range=0..1000)
number_slider_11 = Slider(1, range=1..10)

# ---- group: Constraints
# -- Constraints --
# 
# The minimum hole height is quite small, while still complying with manufacturing tolerances (consider the size required for bolt holes to add fixtures).
# 
# In this example, minimum hole area is redundantl; optimisation is constrained by the minimum hole height.
# 
# Try a large minimum X-spacing in this example: 40mm.
# 
# It is advised to set the X-margin to be > b
number_slider_12 = Slider(152.5, range=0..1000)
number_slider_13 = Slider(40, range=1..100)
number_slider_14 = Slider(10, range=0..1000)
number_slider_15 = Slider(10, range=1..10)
multiplication_2 = Multiplication(A=number_slider_10, B="0.15")
multiplication_3 = Multiplication(A=number_slider_10, B="1")

# ----
cooling_function = ValueList({"Linear": 0, "Exponential": 1, "Logarithmic": 2, "Reciprocal": 3, "Quadratic": 4}, selected="Exponential")
number_slider_16 = Slider(1, range=0..1)
efficiency_mode = ValueList({"Default": 0, "EfficiencyA": 0, "EfficiencyB": 0}, selected="EfficiencyA")
number_slider_17 = Slider(0.548, range=0..1)
initialgeometry = InitialGeometry(
    PlateLengthX=number_slider_9,
    PlateWidthY=number_slider_10,
    Thickness=number_slider_11,
    YoungsModulus=number_slider_7,
    PoissonsRatio=number_slider_8,
    HoleAspectRatio=number_slider_2,
    HoleLength=multiplication,
    HoleHeight=number_slider,
    XSpacing=number_slider_3,
    YSpacing=number_slider_4,
    Columns=number_slider_5,
    Rows=number_slider_6)
constraints = ConstructConstraints(
    MinHoleArea=number_slider_12,
    MinHoleHeight=multiplication_2,
    MinXSpacing=number_slider_13,
    MaxXSpacing=number_slider_9,
    XMargin=multiplication_3,
    MinYSpacing=number_slider_14,
    MaxYSpacing=number_slider_10,
    YMargin=number_slider_15)

# ---- group: Optimise
# -- Optimise --
# 
# In this example, consider EfficiencyA as the Efficiency Mode.
# Unlike the Default Efficiency Mode, both EfficiencyA and EfficiencyB depend on the value k.
# 
# The Default maximises the ratio of perforated-to-unperforated elastic buckling capacity and the ratio of the gross-to-net area.
# 
# EfficiencyA applies a multiplier to the Default mode which favours more columns of perforations. This factor becomes more dominant if k is smaller.
# 
# Similarly, EfficiencyB applies a multiplier to the Default mode to favour more rows of perforations. Again, this factor becomes more dominant if k is smaller.
# 
# As the solution depends on the shape annealing parameters, a pool of solutions should be determined for 25-50 random seeds.
# 
# Repeat this process for different cooling functions if desired.
# 
# In general, a greater value for alpha will increase the stochasticity of the search; less efficient results may be accepted in a given step. It is recommended to have 0.4 < alpha < 0.6.
# 
# Visualise how this changes the probability of acceptance with the Pterodactyl component below.
number_slider_18 = Slider(388, range=1..1000)
panel = Panel("""S
C
G
R""")
optimise = Optimise(
    RandomSeed=number_slider_18,
    MaxIterations=Slider(15, range=1..50),
    Rules=panel,
    Geometry=initialgeometry,
    Constraints=constraints,
    CoolingFunctionCF=cooling_function,
    InitialT=number_slider_16,
    Alpha=number_slider_17,
    EfficiencyMode=efficiency_mode,
    K=Slider(4, range=1..5))
panel_2 = Panel(optimise)

# ---- group: Option: plot probability of acceptance with Pterodactyl
# Under the initial setup, notice that the efficiency does not steadily rise, and less efficient results are selected in the earlier iterations. This is because a larger value for alpha permits stochasticity, which is beneficial to optimisation.
number_slider_19 = Slider(1, range=0..20)
panel_3 = Panel("7")
series = Series(Start=number_slider_19, Step=Slider(1, range=0..20), Count=panel_3)
deconstruct = DeconstructGeometry(Geometry=optimise, Iteration=series)  # -> HoleLength, HoleHeight, Columns, Rows, XSpacing, YSpacing, HoleCentres, Efficiency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
panel_4 = Panel(deconstruct.Efficiency)
probability_of_acceptence = ProbabilityOfAcceptence(
    data=panel_4,
    cooling_schedule=cooling_function,
    T=number_slider_16,
    alpha=number_slider_17,
    step_max=panel_3,
    num=efficiency_fraction)  # -> out, num_3
panel_5 = Panel(probability_of_acceptence.out)

py3 = Python3Script(cooling_schedule=cooling_function)  # -> flatten(colour)
# ---------- py3: Python ----------
if cooling_schedule == 1:
    colour = "97,203,244"
elif cooling_schedule == 2:
    colour = "160,43,147"
elif cooling_schedule == 3:
    colour = "71,212,90"
elif cooling_schedule == 4:
    colour = "233,113,50"
elif cooling_schedule == 0:
    colour = "0,0,255"
print(colour)
# ---------- end py3 ----------
create_x_y_data = CreateXYData(cooling_schedule=cooling_function, T=number_slider_16, alpha=number_slider_17, step_max=panel_3, _0_1=panel_5)  # -> R, R_2
line_data = LineData(Color=ColourSwatch(SwatchColor=RGB(0, 0, 0)), Interpolation=0, LineStyle=0, LineWeight=2)
line_data_2 = LineData(Color=py3, Interpolation=0, LineStyle=0, LineWeight=2)
py3_2 = Python3Script(p=probability_of_acceptence.num_3)  # -> Labels
# ---------- py3_2: Python ----------
ys = ["Temperature"]
ys.append(f"Probability of accepting e_o = {p*100}% of e_i")

ys = "\n".join(str(i) for i in ys)
print(ys)
# ---------- end py3_2 ----------
graph_data = GraphData(XValues=create_x_y_data.R, YValues=create_x_y_data.R_2, ValuesNames=py3_2, DataTypes=[line_data_2, line_data])

# ---- group: Deconstruct
# -- Deconstruct --
# 
# Determine values associated with each step in the optimisation procedure.
# 
# In the 1st iteration, the column (C) rule was selected, giving an efficiency as shown.
# 
# The result is two rows and two columns of perforations, located with x,y,z co-ordinates at the Hole Centres shown.
# 
# After the first iteration, the hole length and hole height are equal to what they were at the beginning, as the geometry has not been grown (G) or shrunk (S).
number_slider_20 = Slider(1, range=0..10)
deconstruct_2 = DeconstructGeometry(Geometry=optimise, Iteration=number_slider_20)  # -> HoleLength, HoleHeight, Rows, Columns, XSpacing, YSpacing, HoleCentres, Efficiency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
panel_6 = Panel(deconstruct_2.Efficiency)
panel_7 = Panel(deconstruct_2.Capacity)
panel_8 = Panel(deconstruct_2.RuleSelected)
panel_9 = Panel(deconstruct_2.YSpacing)
panel_10 = Panel(deconstruct_2.HoleLength)
panel_11 = Panel(deconstruct_2.HoleHeight)
panel_12 = Panel(deconstruct_2.Columns)
panel_13 = Panel(deconstruct_2.XSpacing)
panel_14 = Panel(deconstruct_2.Rows)
panel_15 = Panel(deconstruct_2.HoleCentres)

# ---- group: Option: plot probability of acceptance with Pterodactyl / Print graph with Pterodactyl
# -- Pterodactyl --
# 
# Option to use the Pterodactyl plugin to visualise how the probability of acceptance changes with respect to step.
# 
# From Food4Rhino: https://www.food4rhino.com/en/app/pterodactyl
# 
# 
# Collect the efficiency from each step and use this to determine a hypothetical efficiency at the next step. Change the efficiency fraction as desired, e.g. here the hypothetical efficiency is 85% of the previous step.
# 
# Change the user controls to plot the graph (the directory and folder where you wish to save an image of the resulting graph).
# 
# Click show graph below.
# 
# Try (1) changing alpha (2) changing T and (3) changing the cooling function to see how this affects the probability of acceptance.
show_graph = Button()

# ----
panel_16 = Panel(initialgeometry)
panel_17 = Panel(constraints)

# ---- group: Option: plot probability of acceptance with Pterodactyl / User Controls
panel_18 = Panel("C:\path")
panel_19 = Panel("Graphs")

# ---- group: Option: plot probability of acceptance with Pterodactyl
# Note that the error will vanish when the plot graph button is pressed.
panel_20 = Panel("Temperature-Probability")
graph_legend = GraphLegend(Title="Legend", Position="2", Placement=0, Orientation=1, TextSize="20")
file_pather = Python3Script(
    cooling_schedule=cooling_function,
    Title=panel_20,
    Probability=efficiency_fraction,
    T=number_slider_16,
    alpha=number_slider_17)  # -> out
# ---------- file_pather: Python ----------
if cooling_schedule == 0:
    label = "Linear-Cooling"
elif cooling_schedule == 1:
    label = "Exponential-Cooling"
elif cooling_schedule == 2:
    label = "Logarithmic-Cooling"
elif cooling_schedule == 3:
    label = "Reciprocal-Cooling"
elif cooling_schedule == 4:
    label = "Quadratic-Cooling"


alpha = str(alpha).replace(".", "_")
T = str(T).replace(".", "_")
p = int(float(Probability)*100)
print(Title + "-" + label + "-p" + str(p)+ "-T"+T + "-alpha"+alpha)
# ---------- end file_pather ----------
graph_sizes = GraphSizes(Width="1000", Height="1000")
graph_axis = GraphAxis(XAxisName="Step", YAxisName="Temperature/Probability of Acceptance", AxisPadding=0.01, TextSize="20")
graph_elements = GraphElements(GraphData=graph_data, GraphLegend=graph_legend)
graph_settings = GraphSettings(
    Title="Cooling Schedule With Step",
    GraphSizes=graph_sizes,
    Background=RGB(255, 255, 255),
    GraphAxis=graph_axis,
    GraphPadding="50",
    TitleSize="20")
file_pather_2 = Python3Script(Main_Directory=panel_18, Folder=panel_19, File_Name=file_pather)  # -> out
# ---------- file_pather_2: Python ----------
from datetime import date
today = date.today()
day = today.day
month = today.month
year = today.year

date_stamp = str(day)+"_"+str(month)

out = Main_Directory + "\\" + Folder + "\\" + date_stamp + "_" + File_Name + ".png"
print(out)
# ---------- end file_pather_2 ----------
py3_3 = Python3Script(x=show_graph, path=file_pather_2)  # -> path
# ---------- py3_3: Python ----------
if x is True:
    print(path)
# ---------- end py3_3 ----------
graph = Graph(ShowGraph=show_graph, GraphElements=graph_elements, GraphSettings=graph_settings, Path=py3_3)

# ---- group: Visualise
# -- Undo & Mesh --
# 
# Visualise how the geometry progresses by changing the 'step'.
# 
# Set Step = 0 to get the final geometry
# 
# Set Step = 2 to go two back from the final.
# 
# Set Step = History count (see output from optimised geometry) to see the first iteration.
number_slider_21 = Slider(0, range=0..10)
undogeometry = UndoGeometry(Geometry=optimise, Step=number_slider_21)
materializegeometry = MaterializeGeometry(Geometry=undogeometry, MeshUCount=Slider(75, range=1..100), MeshVCount=Slider(51, range=1..100))  # -> Brep, Mesh
brep = Brep(materializegeometry.Brep)

# ==== cluster ProbabilityOfAcceptence
data = ClusterInput()
num = ClusterInput()
data_2 = Data(data)
num_2 = Number(num)
num_3 = ClusterOutput(num_2)
cooling_schedule = ClusterInput()
T = ClusterInput()
alpha = ClusterInput()
step_max = ClusterInput()
py3 = Python3Script(x=data_2, y=num_2)  # -> z; inputs x: list
# ---------- py3: Python ----------
z = []
for i in x:
    z.append(y*float(i))

z = "\n".join(str(i) for i in z)
print(z)
# ---------- end py3 ----------
py3_2 = Python3Script(e1=data_2, e2=py3, cooling_schedule=cooling_schedule, T=T, alpha=alpha, step_max=step_max)  # -> flatten(out); inputs e1: list, e2: list
# ---------- py3_2: Python ----------
import math

xs = list(range(0,int(step_max)))
ys = []

for (ei, eo, x) in zip(e1, e2, xs):
    if cooling_schedule == 0:
        label = "Linear Cooling"
        nt = max(T- alpha*(x), 0.000001)
    elif cooling_schedule == 1:
        label = "Exponential Cooling"
        nt = T*alpha**x
    elif cooling_schedule == 2:
        label = "Logarithmic Cooling"
        nt = T/math.log(x + alpha)
    elif cooling_schedule == 3:
        label = "Reciprocal Cooling"
        nt = T/(1 + alpha*x)
    elif cooling_schedule == 4:
        label = "Quadratic Cooling"
        nt = T/(1 + alpha*x**2)
    
    ys.append(math.exp(-(float(ei) - float(eo))/float(nt)))

ys = "\n".join(str(i) for i in ys)

print(ys)
# ---------- end py3_2 ----------
out = ClusterOutput(py3_2)

# ==== cluster CreateXYData
cooling_schedule = ClusterInput()
T = ClusterInput()
alpha = ClusterInput()
step_max = ClusterInput()
py3 = Python3Script(cooling_schedule=cooling_schedule, T=T, alpha=alpha, step_max=step_max)  # -> out
# ---------- py3: Python ----------
import math

print(cooling_schedule)

xs = list(range(int(step_max)))
ys = []

for x in xs:
    if cooling_schedule == 0:
        label = "Linear Cooling"
        ys.append(max(T- alpha*(x), 0.000001))
    elif cooling_schedule == 1:
        label = "Exponential Cooling"
        ys.append(T*alpha**x)
    elif cooling_schedule == 2:
        label = "Logarithmic Cooling"
        ys.append(T/math.log(x + alpha))
    elif cooling_schedule == 3:
        label = "Reciprocal Cooling"
        ys.append(T/(1 + alpha*x))
    elif cooling_schedule == 4:
        label = "Quadratic Cooling"
        ys.append(T/(1 + alpha*x**2))

ys = "\n".join(str(i) for i in ys)
print(ys)
print(label)
# ---------- end py3 ----------
series = Series(Start=Slider(1, range=0..20), Step=Slider(1, range=0..20), Count=step_max)
split = SplitList(List=py3, Index=step_max)  # -> ListA, ListB
_0_1 = ClusterInput()
entwine = Entwine(Branch00=series, Branch01=series, FlattenInputs=True)
entwine_2 = Entwine(Branch00=split.ListA, Branch01=_0_1, FlattenInputs=True)
R = ClusterOutput(entwine)
R_2 = ClusterOutput(entwine_2)
